# Grasshopper definition redthread.gh (Grasshopper 1.0.8)

file_path = FilePath("C:\Users\ROG\Desktop\images python\gh_20_architectural_fragments.csv")
read_file = ReadFile(File=file_path, PerLineParse=True)
cull_index = CullIndex(List=read_file, Indices=Slider(0, range=0..1), Wrap=True)
text_split = TextSplit(Text=cull_index, Separators=",")
panel = Panel(text_split)
list_item = ListItem(List=text_split, Index=Slider(10, range=0..20), Wrap=True)
list_item_2 = ListItem(List=text_split, Index=Slider(13, range=0..20), Wrap=True)
list_item_3 = ListItem(List=text_split, Index=Slider(15, range=0..20), Wrap=True)
list_item_4 = ListItem(List=text_split, Index=Slider(12, range=0..20), Wrap=True)
list_item_5 = ListItem(List=text_split, Index=Slider(14, range=0..20), Wrap=True)
list_item_6 = ListItem(List=text_split, Index=Slider(11, range=0..20), Wrap=True)
multiplication = Multiplication(A=list_item_6, B=Slider(2, range=0..20))
multiplication_2 = Multiplication(A=list_item, B=Slider(0.5, range=0..20))
number = Number(multiplication_2)
number_2 = Number(multiplication)
number_3 = Number(list_item_4)
construct_point = ConstructPoint(XCoordinate=number, YCoordinate=number_2, ZCoordinate=number_3)
multiplication_3 = Multiplication(A=list_item_2, B=Slider(10, range=0..20))
unit_z = UnitZ(Factor=1)
multiplication_4 = Multiplication(A=list_item_2, B=Slider(0.5, range=0..20))
amplitude = Amplitude(Vector=unit_z, Amplitude=list_item_3)
number_4 = Number(list_item_5)
number_5 = Number(list_item_5)
circle_cnr = CircleCNR(Center=construct_point, Normal=Vector(0, 0, 1), Radius=multiplication_3)
divide_curve = DivideCurve(Curve=circle_cnr, Count=number_5, Kinks=False)  # -> Points, Tangents, Parameters
move = Move(Geometry=circle_cnr, Motion=amplitude)  # -> Geometry, Transform
rotate = Rotate(Geometry=move.Geometry, Angle=Slider(1.8, range=0..20), Plane=circle_cnr)  # -> Geometry, Transform
divide_curve_2 = DivideCurve(Curve=rotate.Geometry, Count=number_4, Kinks=False)  # -> Points, Tangents, Parameters
line = Line(StartPoint=divide_curve.Points, EndPoint=divide_curve_2.Points)
loft = Loft(
    Curves=[circle_cnr, rotate.Geometry],
    Options={Adjust=False, Closed=False, LoftEnds=0, LoftSimp=0, LoftType=0, Rebuild=10, Refit=0.01})
shift_list = ShiftList(List=divide_curve.Points, Shift=Slider(2.4, range=0..20), Wrap=Toggle(True))
shift_list_2 = ShiftList(List=divide_curve_2.Points, Shift=Slider(7.8, range=0..20), Wrap=Toggle(True))
line_2 = Line(StartPoint=divide_curve_2.Points, EndPoint=shift_list)
pipe = Pipe(Curve=line, Radius=multiplication_4, Caps=0)
line_3 = Line(StartPoint=divide_curve.Points, EndPoint=shift_list_2)
merge = Merge(Data1=line_2, Data2=line_3)
divide_curve_3 = DivideCurve(Curve=merge, Count=Slider(3, range=0..5), Kinks=False)  # -> flatten(Points), Tangents, Parameters
number_slider = Slider(60, range=0..80)
number_slider_2 = Slider(0, range=-0.001..100)
shift_list_3 = ShiftList(List=divide_curve_3.Points, Shift=Slider(7, range=0..7), Wrap=Toggle(True))
line_4 = Line(StartPoint=divide_curve_3.Points, EndPoint=shift_list_3)
list_length = ListLength(List=line_4)
random = Random(Range=Slider(0.667, range=-0.001..1), Number=list_length, Seed=2)
smaller_than = SmallerThan(FirstNumber=random, SecondNumber=Slider(0.164, range=-0.001..1))  # -> SmallerThan, OrEqualTo
cull_pattern = CullPattern(List=line_4, CullPattern=smaller_than.SmallerThan)
unit_z_2 = UnitZ(Factor=1)
random_2 = Random(Range=Slider(2, range=0..7), Number=Slider(4.542, range=0..7), Seed=Slider(4.43, range=0..7))
unit_x = UnitX(Factor=1)
divide_curve_4 = DivideCurve(Curve=cull_pattern, Count=Slider(5, range=0..7), Kinks=False)  # -> Points, Tangents, Parameters
amplitude_2 = Amplitude(Vector=unit_x, Amplitude=Slider(0.5, range=0..7))
amplitude_3 = Amplitude(Vector=unit_z_2, Amplitude=random_2)
addition = Addition(A=amplitude_3, B=amplitude_2)
move_2 = Move(Geometry=divide_curve_4.Points, Motion=addition)  # -> Geometry, Transform
interpolate = Interpolate(Vertices=move_2.Geometry, Degree=3, Periodic=False, KnotStyle=1)  # -> Curve, Length, Domain
random_3 = Random(Range=Slider(0.05, range=0..7), Number=Slider(1.2, range=0..7), Seed=Slider(2, range=0..7))
pipe_2 = Pipe(Curve=interpolate.Curve, Radius=random_3, Caps=0)
custom_preview = CustomPreview(Geometry=pipe_2, Material=ColourSwatch(SwatchColor=RGB(255, 255, 255)))
